# Grasshopper definition CULL DUPLICATES OF ANY TYPE.gh (Grasshopper 1.0.7)

# ---- group: CULL DUPLICATES OF ANY TYPE
# CULL DUPLICATES OF ANY TYPE
# https://pedroazambujavarela.net/cull-duplicates-of-any-type/
relay = Relay()
panel = Panel("LIST of DATA")
panel_2 = Panel("Criteria")
len = Length(Curve=relay)
data = Data(relay)
data_2 = Data(len)
sunion = SetUnion(SetA=data_2, SetB=data_2)
equals = Equality(FirstNumber=data_2, SecondNumber=graft(sunion))  # -> Equality, Inequality
cull = CullPattern(List=data, CullPattern=equals.Equality)
item = ListItem(List=cull, Index=0, Wrap=True)
