# Grasshopper definition Comparacio de dos LListes.gh (Grasshopper 1.0.7)

# ---- group: Comparacio de dos LListes
cset = CreateSet()  # -> Set, Map
cset_2 = CreateSet()  # -> Set, Map
intersection = SetIntersection(SetA=cset.Set, SetB=cset_2.Set)
exdiff = SetDifferenceS(SetA=cset.Set, SetB=cset_2.Set)
preview = CustomPreview(Geometry=intersection, Shader=ColourSwatch(SwatchColor=RGB(0, 0, 255)))
preview_2 = CustomPreview(Geometry=exdiff, Shader=ColourSwatch(SwatchColor=RGB(255, 255, 0)))
