# Grasshopper definition McLayers.gh (Grasshopper 1.0.7)
# plug-ins: FalseStartToggle

python = GhPythonScript()  # -> Out, Layer, Objects
c_script = CSharpScript()  # -> out, Layer, Objects
# ---------- c_script: C# ----------
    List<string> layerList = new List<string>();
    Grasshopper.DataTree<string> layernames = new Grasshopper.DataTree<string>();
    Grasshopper.DataTree<object> objects = new Grasshopper.DataTree<object>();

    foreach (Rhino.DocObjects.Layer layer in RhinoDoc.ActiveDoc.Layers)
    {
      layerList.Add(layer.FullPath);
    }

    for (int i = 0; i < layerList.Count; i++)
    {
      Rhino.DocObjects.RhinoObject[] rhinoObjects = doc.Objects.FindByLayer(layerList[i]);
      if (rhinoObjects != null && rhinoObjects.Length > 0)
      {
        layernames.Add(layerList[i], new GH_Path(i));
        foreach (var rhinoObject in rhinoObjects)
        {
          objects.Add(rhinoObject.Geometry, new GH_Path(i));
        }
      }
    }

    Layer = layernames;
    Objects = objects;
# ---------- end c_script ----------
c_script_2 = CSharpScript()  # -> out, Layer, Objects; same code as c_script
panel = Panel(c_script.Layer)
panel_2 = Panel(c_script_2.Layer)
panel_3 = Panel(python.Layer)
Z = UnitZ(Factor=panel_2)
move = Move(Geometry=c_script_2.Objects, Motion=Z)  # -> Geometry, Transform
python_2 = GhPythonScript(run=Toggle(True), ParentFolder="-2D-coord")  # -> out, Layer, Objects; inputs run: Boolean
# ---------- python_2: Python ----------
__author__ = "aqag"
__version__ = "2024.07.13"

import rhinoscriptsyntax as rs

import Rhino
import clr
clr.AddReference('RhinoCommon')
from Rhino import *
from Grasshopper import DataTree
from Grasshopper.Kernel.Data import GH_Path
from System.Collections.Generic import List

def RunScript(ParentFolder):
    layerList = List[str]()
    layernames = DataTree[str]()
    objects = DataTree[object]()
    
    # Obtener las capas del documento activo
    layers = Rhino.RhinoDoc.ActiveDoc.Layers
    
    # Filtrar las capas según el nombre del padre
    for layer in layers:
        if ParentFolder:
            if Rhino.DocObjects.Layer.GetParentName(layer) == ParentFolder:
                layerList.Add(layer.Name)
        else:
            layerList.Add(layer.Name)
    
    # Obtener objetos de cada capa
    for i in range(layerList.Count):
        rhinoObjects = Rhino.RhinoDoc.ActiveDoc.Objects.FindByLayer(layerList[i])
        if rhinoObjects and len(rhinoObjects) > 0:
            layernames.Add(layerList[i], GH_Path(i))
            for rhinoObject in rhinoObjects:
                objects.Add(rhinoObject.Geometry, GH_Path(i))
    
    return layernames, objects


def LayersList(ParentFolder):
    layerList = List[str]()
    layernames = DataTree[str]()
    objects = DataTree[object]()
    
    # Obtener las capas del documento activo
    layers = Rhino.RhinoDoc.ActiveDoc.Layers
    
    # Filtrar las capas según el nombre del padre
    for layer in layers:
        if ParentFolder:
            if Rhino.DocObjects.Layer.GetParentName(layer) == ParentFolder:
                layerList.Add(layer.Name)
        else:
            layerList.Add(layer.Name)
    
    # Obtener objetos de cada capa
    for i in range(layerList.Count):
        rhinoObjects = Rhino.RhinoDoc.ActiveDoc.Objects.FindByLayer(layerList[i])
        if rhinoObjects and len(rhinoObjects) > 0:
            layernames.Add(layerList[i], GH_Path(i))
            for rhinoObject in rhinoObjects:
                objects.Add(rhinoObject.Geometry, GH_Path(i))
    
    return layernames, objects


# Llamada a la función principal
if run:
    Layer, Objects = RunScript(ParentFolder)
# ---------- end python_2 ----------
panel_4 = Panel(move.Geometry)
panel_5 = Panel(python_2.Layer)
panel_6 = Panel(python_2.Objects)
c_script_3 = CSharpScript(ParentFolder="lines")  # -> out, Layer, Objects; inputs ParentFolder: String
# ---------- c_script_3: C# ----------
    List<string> layerList = new List<string>();
    Grasshopper.DataTree<string> layernames = new Grasshopper.DataTree<string>();
    Grasshopper.DataTree<object> objects = new Grasshopper.DataTree<object>();

    foreach (Rhino.DocObjects.Layer layer in RhinoDoc.ActiveDoc.Layers)
    {
      if (ParentFolder != null)
      {
        if ((Rhino.DocObjects.Layer.GetParentName(layer)) == ParentFolder)
        {
          layerList.Add(layer.Name);
        }
      }
      else
      {
        layerList.Add(layer.Name);
      }
    }

    for (int i = 0; i < layerList.Count; i++)
    {
      Rhino.DocObjects.RhinoObject[] rhinoObjects = doc.Objects.FindByLayer(layerList[i]);
      if (rhinoObjects != null && rhinoObjects.Length > 0)
      {
        layernames.Add(layerList[i], new GH_Path(i));
        foreach (var rhinoObject in rhinoObjects)
        {
          objects.Add(rhinoObject.Geometry, new GH_Path(i));
        }
      }
    }

    Layer = layernames;
    Objects = objects;
# ---------- end c_script_3 ----------
panel_7 = Panel(c_script_3.Layer)
Z_2 = UnitZ(Factor=panel_7)
python_3 = GhPythonScript(run=Toggle(True), ParentFolder="-2D-*")  # -> out, Layer, Objects; inputs run: Boolean
# ---------- python_3: Python ----------
__author__ = "aqag"
__version__ = "2024.07.13"

import rhinoscriptsyntax as rs

import Rhino
import clr
clr.AddReference('RhinoCommon')
from Rhino import *
from Grasshopper import DataTree
from Grasshopper.Kernel.Data import GH_Path
from System.Collections.Generic import List


import re

def wildcard_to_regex(wildcard):
    # Convierte un patrón de comodín a una expresión regular
    return re.compile(r'^' + re.escape(wildcard).replace(r'\*', '.*') + r'$')

def RunScript(ParentFolder):
    layerList = List[str]()
    layernames = DataTree[str]()
    objects = DataTree[object]()
    
    # Obtener las capas del documento activo
    layers = Rhino.RhinoDoc.ActiveDoc.Layers
    
    # Preparar expresión regular para el patrón de comodín
    if ParentFolder:
        regex = wildcard_to_regex(ParentFolder)
    
    # Filtrar las capas según el nombre del padre
    for layer in layers:
        if ParentFolder:
            if Rhino.DocObjects.Layer.GetParentName(layer) == ParentFolder:
                layerList.Add(layer.Name)
        else:
            layerList.Add(layer.Name)
    
    # Obtener objetos de cada capa
    for i in range(layerList.Count):
        rhinoObjects = Rhino.RhinoDoc.ActiveDoc.Objects.FindByLayer(layerList[i])
        if rhinoObjects and len(rhinoObjects) > 0:
            layernames.Add(layerList[i], GH_Path(i))
            for rhinoObject in rhinoObjects:
                objects.Add(rhinoObject.Geometry, GH_Path(i))
    
    return layernames, objects


def LayersList(ParentFolder):
    layerList = List[str]()
    layernames = DataTree[str]()
    objects = DataTree[object]()
    
    # Obtener las capas del documento activo
    layers = Rhino.RhinoDoc.ActiveDoc.Layers
    
    # Filtrar las capas según el nombre del padre
    for layer in layers:
        if ParentFolder:
            if Rhino.DocObjects.Layer.GetParentName(layer) == ParentFolder:
                layerList.Add(layer.Name)
        else:
            layerList.Add(layer.Name)
    
    # Obtener objetos de cada capa
    for i in range(layerList.Count):
        rhinoObjects = Rhino.RhinoDoc.ActiveDoc.Objects.FindByLayer(layerList[i])
        if rhinoObjects and len(rhinoObjects) > 0:
            layernames.Add(layerList[i], GH_Path(i))
            for rhinoObject in rhinoObjects:
                objects.Add(rhinoObject.Geometry, GH_Path(i))
    
    return layernames, objects


# Llamada a la función principal
if run:
    Layer, Objects = RunScript(ParentFolder)
# ---------- end python_3 ----------
move_2 = Move(Motion=Z_2)  # -> Geometry, Transform
# Put FALSE
# after export
panel_8 = Panel(c_script_3.Objects)
panel_9 = Panel(python_3.Layer)
panel_10 = Panel(python_3.Objects)
python_4 = GhPythonScript(run=Toggle(True))  # -> out, Layer, Objects; inputs run: Boolean
# ---------- python_4: Python ----------
__author__ = "aqag"
__version__ = "2024.07.13"

import rhinoscriptsyntax as rs

import Rhino
import clr
clr.AddReference('RhinoCommon')
from Rhino import *
from Grasshopper import DataTree
from Grasshopper.Kernel.Data import GH_Path
from System.Collections.Generic import List

def RunScript(ParentFolder):
    layerList = List[str]()
    layernames = DataTree[str]()
    objects = DataTree[object]()
    
    # Obtener las capas del documento activo
    layers = Rhino.RhinoDoc.ActiveDoc.Layers
    
    # Filtrar las capas según el nombre del padre
    for layer in layers:
        parent_name = Rhino.DocObjects.Layer.GetParentName(layer)
        if ParentFolder:
            if parent_name.startswith(ParentFolder):
                layerList.Add(layer.Name)
        else:
            layerList.Add(layer.Name)
    
    # Obtener objetos de cada capa
    for i in range(layerList.Count):
        rhinoObjects = Rhino.RhinoDoc.ActiveDoc.Objects.FindByLayer(layerList[i])
        if rhinoObjects and len(rhinoObjects) > 0:
            layernames.Add(layerList[i], GH_Path(i))
            for rhinoObject in rhinoObjects:
                objects.Add(rhinoObject.Geometry, GH_Path(i))
    
    return layernames, objects


# Llamada a la función principal
if run:
    Layer, Objects = RunScript(ParentFolder)
# ---------- end python_4 ----------
panel_11 = Panel(python_4.Layer)
panel_12 = Panel(python_4.Objects)
panel_13 = Panel("""Stage01
Stage02
Stage03
Stage04""")
# Create List Layer
py_laylst = CreateAListOfLayers(run=Toggle(True), ParentFolder="-", Filter="a")  # -> out, Layer; inputs run: Boolean
# ---------- py_laylst: Python ----------
# Creates a list of layers of drawing
#
#
# Copyright (c) 2024, Jordi Nebot <jordinebotroca@gmail.com>
# This rutine is free software: you can redistribute it and/or modify it under the terms of the GNU General Public License as published by the Free Software Foundation, either version 3 of the License, or (at your option) any later version.
#
# This rutine is distributed in the hope that it will be useful, but WITHOUT ANY WARRANTY; without even the implied warranty of MERCHANTABILITY or FITNESS FOR A PARTICULAR PURPOSE. See the GNU General Public License for more details.
#
# You should have received a copy of the GNU General Public License along with this program. If not, see http://www.gnu.org/licenses/.
#
# The GPL-3.0+ license <http://spdx.org/licenses/GPL-3.0+>
#
"""Use this component to Create a list of layers of drawing.
    Inputs:
        run: Name of Layer to create
        ParentFolder: string or first letter of the ParentFolder in the list of layers if exist sub folders in drawing
        Filter: string to uses as a filter in the list of layers of drawing
    Output:
        Layer: List of layers with objects
"""
        
__author__ = "McNeibot"
__version__ = "2024.07.13"
                        
ghenv.Component.Name = "Create a List of Layers"
ghenv.Component.NickName =  "Py_LayLst"
ghenv.Component.Message = "VER 1.0\nJUL_2024"
#ghenv.Component.IconDisplayMode = ghenv.Component.IconDisplayMode.application
#ghenv.Component.Category = "McNeibot"
#ghenv.Component.SubCategory = "0 | McNeibot"
#compatibleGismoVersion = VER 0.0.3\nJAN_29_2019

                        
# -*- coding: utf-8 -*-                                                                                  
        


import rhinoscriptsyntax as rs

import Rhino
import clr
clr.AddReference('RhinoCommon')
from Rhino import *
from Grasshopper import DataTree
from Grasshopper.Kernel.Data import GH_Path
from System.Collections.Generic import List

def RunScript(ParentFolder, Filter=""):
    if ParentFolder: ParentFolder = ParentFolder.upper()
    
    #print Filter
    if Filter == None: Filter = ""
    if Filter: Filter = Filter.upper()
    #print Filter
    layerList = List[str]()
    layernames = DataTree[str]()
    objects = DataTree[object]()
    
    # Obtener las capas del documento activo
    layers = Rhino.RhinoDoc.ActiveDoc.Layers
    
    # Filtrar las capas según el nombre del padre
    for layer in layers:
        #print layer #type layer
        #print Rhino.DocObjects.Layer.ToString(layer) #type string
        parent_name = Rhino.DocObjects.Layer.GetParentName(layer) #type string
        layer_name = Rhino.DocObjects.Layer.ToString(layer) #type string
        parent_name = parent_name.upper() #type string
        layer_nameU = layer_name.upper() #type string
        #print Filter
        if ParentFolder:
            if parent_name.startswith(ParentFolder):
                #print ParentFolder
                #print Filter
                if Filter in layer_nameU:
                    #print Filter
                    #print layer.Name
                    layerList.Add(layer.Name)
        else:
            if Filter:
                #print layer_nameU
                if Filter in layer_nameU:
                    #print "filter"
                    layerList.Add(layer.Name)
                    #print (layer.Name)
            else:
                layerList.Add(layer.Name)
    

    return layerList

# Llamada a la función principal
if run:
    Layer = RunScript(ParentFolder,Filter)
# ---------- end py_laylst ----------
py_layobj = CreateALayerListWithObjectsList(run=Toggle(True), ParentFolder="-", Filter="c")  # -> out, Layer, Objects; inputs run: Boolean
# ---------- py_layobj: Python ----------
# Creates a list of layers and another list of objects in the layers in the list
#
#
# Copyright (c) 2024, Jordi Nebot <jordinebotroca@gmail.com>
# This rutine is free software: you can redistribute it and/or modify it under the terms of the GNU General Public License as published by the Free Software Foundation, either version 3 of the License, or (at your option) any later version.
#
# This rutine is distributed in the hope that it will be useful, but WITHOUT ANY WARRANTY; without even the implied warranty of MERCHANTABILITY or FITNESS FOR A PARTICULAR PURPOSE. See the GNU General Public License for more details.
#
# You should have received a copy of the GNU General Public License along with this program. If not, see http://www.gnu.org/licenses/.
#
# The GPL-3.0+ license <http://spdx.org/licenses/GPL-3.0+>
#
"""Use this component to Create a list of layers and another list of objects in the layers-list.
    Inputs:
        run: Name of Layer to create
        ParentFolder: string or firsts letters of the ParentFolder in the list of layers if exist subLayers in drawing
        Filter: string to uses as a filter in the list of layers of drawing
    Output:
        Layer: List of layers with objects
        Objects: List of objects
"""
        
__author__ = "McNeibot"
__version__ = "2024.07.13"
                        
ghenv.Component.Name = "Create a Layer List with objects List"
ghenv.Component.NickName =  "Py_LayObj"
ghenv.Component.Message = "VER 1.0\nJUL_2024"
#ghenv.Component.IconDisplayMode = ghenv.Component.IconDisplayMode.application
#ghenv.Component.Category = "McNeibot"
#ghenv.Component.SubCategory = "0 | McNeibot"
#compatibleGismoVersion = VER 0.0.3\nJAN_29_2019

                        
# -*- coding: utf-8 -*-                                                                                  
        


import rhinoscriptsyntax as rs

import Rhino
import clr
clr.AddReference('RhinoCommon')
from Rhino import *
from Grasshopper import DataTree
from Grasshopper.Kernel.Data import GH_Path
from System.Collections.Generic import List

def RunScript(ParentFolder, Filter=""):
    if ParentFolder: ParentFolder = ParentFolder.upper()
    
    #print Filter
    if Filter == None: Filter = ""
    if Filter: Filter = Filter.upper()
    #print Filter
    layerList = List[str]()
    layernames = DataTree[str]()
    objects = DataTree[object]()
    
    # Obtener las capas del documento activo
    layers = Rhino.RhinoDoc.ActiveDoc.Layers
    
    # Filtrar las capas según el nombre del padre
    for layer in layers:
        #print layer #type layer
        #print Rhino.DocObjects.Layer.ToString(layer) #type string
        parent_name = Rhino.DocObjects.Layer.GetParentName(layer) #type string
        layer_name = Rhino.DocObjects.Layer.ToString(layer) #type string
        #print type(parent_name)
        #print parent_name
        #print type(layer_name)
        #print layer_name
        parent_name = parent_name.upper() #type string
        layer_nameU = layer_name.upper() #type string
        #print Filter
        if ParentFolder:
            if parent_name.startswith(ParentFolder):
                #print ParentFolder
                #print Filter
                if Filter in layer_nameU:
                    #print Filter
                    #print layer.Name
                    layerList.Add(layer.Name)
        else:
            if Filter:
                #print layer_nameU
                if Filter in layer_nameU:
                    #print "filter"
                    layerList.Add(layer.Name)
                    #print (layer.Name)
            else:
                layerList.Add(layer.Name)
    
    # Obtener objetos de cada capa
    for i in range(layerList.Count):
        rhinoObjects = Rhino.RhinoDoc.ActiveDoc.Objects.FindByLayer(layerList[i])
        if rhinoObjects and len(rhinoObjects) > 0:
            layernames.Add(layerList[i], GH_Path(i))
            for rhinoObject in rhinoObjects:
                objects.Add(rhinoObject.Geometry, GH_Path(i))
    
    return layernames, objects#layerList, objects

# Llamada a la función principal
if run:
    Layer, Objects = RunScript(ParentFolder,Filter)
# ---------- end py_layobj ----------
toggle = BooleanToggle(True)
button = Button()
toggle_2 = FalseStartToggle(False)
# Create List Layer with Objects in Layer
panel_14 = Panel(py_layobj.Objects)
panel_15 = Panel(py_laylst.Layer)
# Create Layer with Color
py_laycol = CreateOrModifyALayerWithColor(
    NameLayer=panel_13,
    color=[ColourSwatch(SwatchColor=RGB(255, 255, 255)), ColourSwatch(SwatchColor=RGB(230, 41, 46)), ColourSwatch(SwatchColor=RGB(214, 251, 72)), ColourSwatch(SwatchColor=RGB(22, 41, 255))],
    do=toggle_2)  # -> out, Layer, LayerColor; inputs do: Boolean
# ---------- py_laycol: Python ----------
# Create a layer with color, or modify just the layer color
#
#
# Copyright (c) 2024, Jordi Nebot <jordinebotroca@gmail.com>
# This rutine is free software: you can redistribute it and/or modify it under the terms of the GNU General Public License as published by the Free Software Foundation, either version 3 of the License, or (at your option) any later version.
#
# This rutine is distributed in the hope that it will be useful, but WITHOUT ANY WARRANTY; without even the implied warranty of MERCHANTABILITY or FITNESS FOR A PARTICULAR PURPOSE. See the GNU General Public License for more details.
#
# You should have received a copy of the GNU General Public License along with this program. If not, see http://www.gnu.org/licenses/.
#
# The GPL-3.0+ license <http://spdx.org/licenses/GPL-3.0+>
#
"""Use this component to Create a layer with color, or modify just the layer color.
    Inputs:
        NameLayer: Name of Layer to create
        color: color of the layer to create or modify
        do: boolean input to do
    Output:
        Layer: List of layers
        PayerColor: List of colors
"""
        
__author__ = "McNeibot"
__version__ = "2024.07.09"
                        
ghenv.Component.Name = "Create or Modify a Layer with color"
ghenv.Component.NickName =  "Py_LayCol"
ghenv.Component.Message = "VER 1.0\nJUL_2024"
#ghenv.Component.IconDisplayMode = ghenv.Component.IconDisplayMode.application
#ghenv.Component.Category = "McNeibot"
#ghenv.Component.SubCategory = "0 | McNeibot"
#compatibleGismoVersion = VER 0.0.3\nJAN_29_2019

                        
# -*- coding: utf-8 -*-                                                                                  
        


import Rhino
import scriptcontext as sc
import System
import System.Drawing.Color

def change_layer_color(layer_name, layer_color):
    # Save the current document context
    previous_doc = sc.doc
    
    # Switch the context to the Rhino document
    sc.doc = Rhino.RhinoDoc.ActiveDoc
    
    # Find the layer index by name
    layer_index = sc.doc.Layers.FindByFullPath(layer_name, True)
    
    if layer_index >= 0:
        # Get the layer
        layer = sc.doc.Layers[layer_index]
        
        # Set the new color
        layer.Color = layer_color
        
        # Commit the changes to the document
        layer.CommitChanges()
        print("Layer '{}' color changed successfully.".format(layer_name))
    else:
        print("Layer '{}' does not exist.".format(layer_name))
    
    # Restore the previous document context
    sc.doc = previous_doc

def add_layer(layer_name, layer_color):
    # Save the current document context
    previous_doc = sc.doc
    
    # Switch the context to the Rhino document
    sc.doc = Rhino.RhinoDoc.ActiveDoc
    
    # Check if the layer already exists
    if sc.doc.Layers.FindByFullPath(layer_name, True) < 0:
        # Create a new layer
        layer_index = sc.doc.Layers.Add(layer_name, layer_color)
        if layer_index >= 0:
            print("Layer '{}' added successfully.".format(layer_name))
        else:
            print("Failed to add layer '{}'.".format(layer_name))
    else:
        print("Layer '{}' already exists.".format(layer_name))
        change_layer_color(layer_name, layer_color)
    
    # Restore the previous document context
    sc.doc = previous_doc

# Input parameters
layer_name = "NuevaCapa"
layer_color = Rhino.ApplicationSettings.AppearanceSettings.DefaultLayerColor

if color is None:
    blue = System.Drawing.Color.Blue
    color = blue #color = (255, 0, 0, 255) #RGBA

if NameLayer and do:
    # Call the function to add the layer
    add_layer(NameLayer, color)
    Layer = NameLayer
    LayerColor = color
    print Layer,"  ", LayerColor
# ---------- end py_laycol ----------
panel_16 = Panel(py_layobj.Layer)

# ----
# List of Layers
# to Create o Modify
# List of Colors
# to associate to Layers
# Create or Modify Layers in Drawing
swatch = ColourSwatch(SwatchColor=RGB(230, 41, 46))
panel_17 = Panel("""Stage01
Stage02
Stage03
Stage04""")
toggle_3 = FalseStartToggle(False)
relay = Relay([ColourSwatch(SwatchColor=RGB(255, 255, 255)), swatch, ColourSwatch(SwatchColor=RGB(214, 251, 72)), ColourSwatch(SwatchColor=RGB(22, 41, 255))])
py_laycol_2 = CreateOrModifyALayerWithColor(NameLayer=panel_17, color=relay, do=toggle_3)  # -> out, Layer, LayerColor; inputs do: Boolean; same code as py_laycol

toggle_4 = BooleanToggle(True)
button_2 = Button()

# ----
# Create List Layer
panel_18 = Panel("-")
py_laylst_2 = CreateAListOfLayers(run=Toggle(True), ParentFolder=panel_18, Filter="a")  # -> out, Layer; inputs run: Boolean; same code as py_laylst
panel_19 = Panel(py_laylst_2.Layer)

panel_20 = Panel("8")
py_mcslider = ControlASlider(dynamic_slider=Slider(9, range=0..15.8), max_val="15.8")  # -> out, value; inputs min_val: Int32
# ---------- py_mcslider: Python ----------
# To dynamically control a Slider. Set a min and max externally
#
#
# Copyright (c) 2024, Jordi Nebot <jordinebotroca@gmail.com>
# This rutine is free software: you can redistribute it and/or modify it under the terms of the GNU General Public License as published by the Free Software Foundation, either version 3 of the License, or (at your option) any later version.
#
# This rutine is distributed in the hope that it will be useful, but WITHOUT ANY WARRANTY; without even the implied warranty of MERCHANTABILITY or FITNESS FOR A PARTICULAR PURPOSE. See the GNU General Public License for more details.
#
# You should have received a copy of the GNU General Public License along with this program. If not, see http://www.gnu.org/licenses/.
#
# The GPL-3.0+ license <http://spdx.org/licenses/GPL-3.0+>
#
"""Use this component to To dynamically control a Slider. Set a min and max externally.
    Inputs:
        dynamic_slider: link with a slider, config the units inside it
        max_val: Sets the maximum value of the dynamic_slider. Pay attention to the decimals, it may be necessary to reconfigure the native slider. If not =100
        min_val: Sets the minumun value of the dynamic_slider. Pay attention to the decimals, it may be necessary to reconfigure the native slider. If not =0
    Output:
        value: Value of th dynamic_slider after to move it
"""
        
__author__ = "McNeibot"
__version__ = "2024.07.13"
                        
ghenv.Component.Name = "Control a Slider"
ghenv.Component.NickName =  "Py_McSlider"
ghenv.Component.Message = "VER 1.0\nJUL_2024"
#ghenv.Component.IconDisplayMode = ghenv.Component.IconDisplayMode.application
#ghenv.Component.Category = "McNeibot"
#ghenv.Component.SubCategory = "0 | McNeibot"
#compatibleGismoVersion = VER 0.0.3\nJAN_29_2019

                        
# -*- coding: utf-8 -*-                                                                                  
        

import clr
clr.AddReference('RhinoCommon')
import Rhino
import scriptcontext as sc
import Grasshopper
import Grasshopper.Kernel as gh
import Grasshopper.Kernel.Special as gh_special

def update_slider(slider, min_val, max_val):
    if slider is None:
        return

    # Configurar los límites mínimos y máximos del slider
    slider.Slider.Minimum = min_val
    slider.Slider.Maximum = max_val
    slider.Slider.TickFrequency = (max_val - min_val) / 10 if (max_val - min_val) > 0 else 1
    
    # Ajustar el valor del slider si está fuera de los nuevos límites
    if slider.Slider.Value < min_val or slider.Slider.Value > max_val:
        slider.Slider.Value = min_val
    
    # Expirar la solución para actualizar el slider
    slider.ExpireSolution(True)

# Obtener el slider conectado al componente Python
dynamic_slider = ghenv.Component.Params.Input[0].Sources[0]

# Verificar que el slider sea del tipo GH_NumberSlider
if not isinstance(dynamic_slider, gh_special.GH_NumberSlider):
    raise TypeError("El elemento conectado debe ser un slider de tipo GH_NumberSlider.")

# Definir los valores mínimo y máximo dinámicos
if min_val is None:
    min_val = 0  # Por ejemplo, puedes definir el valor mínimo aquí
if max_val is None:
    max_val = 100  # Por ejemplo, puedes definir el valor máximo aquí

# Actualizar el slider dinámico
update_slider(dynamic_slider, min_val, max_val)

# Salida del valor actual del slider dinámico
value = dynamic_slider.Slider.Value
# ---------- end py_mcslider ----------
panel_21 = Panel(py_mcslider.value)

# ----
# One Layer of the List
lng = ListLength(List=py_laylst_2.Layer)
panel_22 = Panel(lng)

panel_23 = Panel("15.8")
relay_2 = Relay()
py_mcslider_2 = ControlASlider(dynamic_slider=Slider(0, range=0..10), max_val=lng, min_val=relay_2)  # -> out, value; inputs min_val: Int32; same code as py_mcslider

panel_25 = Panel(py_mcslider_2.value)
item = ListItem(List=py_laylst_2.Layer, Index=py_mcslider_2.value, Wrap=True)
panel_26 = Panel(item)
