# Grasshopper definition McSlider.gh (Grasshopper 1.0.7)

number_slider = Slider(4, range=0..10)
number_slider_2 = Slider(17, range=1..20)
python = GhPythonScript(dynamic_slider=Slider(11, range=3..17), max_val=Slider(17, range=1..20), min_val=Slider(3, range=0..10))  # -> out, value
# ---------- python: Python ----------
__author__ = "aqag"
__version__ = "2024.07.13"

import rhinoscriptsyntax as rs

import clr
clr.AddReference('RhinoCommon')
import Rhino
import scriptcontext as sc
import Grasshopper
import Grasshopper.Kernel as gh
import Grasshopper.Kernel.Special as gh_special

def update_slider(slider, min_val, max_val):
    if slider is None:
        return

    slider.Slider.Minimum = min_val
    slider.Slider.Maximum = max_val
    slider.Slider.TickFrequency = (max_val - min_val) / 10 if (max_val - min_val) > 0 else 1
    if slider.Slider.Value < min_val or slider.Slider.Value > max_val:
        slider.Slider.Value = min_val
    slider.ExpireSolution(True)

# Obtener los sliders conectados al componente Python
dynamic_slider = ghenv.Component.Params.Input[0].Sources[0]
max_slider = ghenv.Component.Params.Input[1].Sources[0]
min_slider = ghenv.Component.Params.Input[2].Sources[0]


# Verificar que los sliders sean del tipo GH_NumberSlider
if not isinstance(min_slider, gh_special.GH_NumberSlider) or not isinstance(max_slider, gh_special.GH_NumberSlider) or not isinstance(dynamic_slider, gh_special.GH_NumberSlider):
    raise TypeError("Todos los elementos conectados deben ser sliders de tipo GH_NumberSlider.")

# Definir los valores mínimo y máximo dinámicos
min_val = min_slider.Slider.Value
max_val = max_slider.Slider.Value

# Actualizar el slider dinámico
update_slider(dynamic_slider, min_val, max_val)

# Salida del valor actual del slider dinámico
value = dynamic_slider.Slider.Value
# ---------- end python ----------
python_2 = GhPythonScript(dynamic_slider=Slider(8, range=8..15), max_val="15", min_val="8")  # -> out, value
# ---------- python_2: Python ----------
__author__ = "aqag"
__version__ = "2024.07.13"

import rhinoscriptsyntax as rs

import clr
clr.AddReference('RhinoCommon')
import Rhino
import scriptcontext as sc
import Grasshopper
import Grasshopper.Kernel as gh
import Grasshopper.Kernel.Special as gh_special

def update_slider(slider, min_val, max_val):
    if slider is None:
        return

    slider.Slider.Minimum = min_val
    slider.Slider.Maximum = max_val
    slider.Slider.TickFrequency = (max_val - min_val) / 10 if (max_val - min_val) > 0 else 1
    if slider.Slider.Value < min_val or slider.Slider.Value > max_val:
        slider.Slider.Value = min_val
    slider.ExpireSolution(True)

# Obtener los sliders conectados al componente Python
dynamic_slider = ghenv.Component.Params.Input[0].Sources[0]
#max_slider = ghenv.Component.Params.Input[1].Sources[0]
#min_slider = ghenv.Component.Params.Input[2].Sources[0]

"""
# Verificar que los sliders sean del tipo GH_NumberSlider
if not isinstance(min_slider, gh_special.GH_NumberSlider) or not isinstance(max_slider, gh_special.GH_NumberSlider) or not isinstance(dynamic_slider, gh_special.GH_NumberSlider):
    raise TypeError("Todos los elementos conectados deben ser sliders de tipo GH_NumberSlider.")

# Definir los valores mínimo y máximo dinámicos
min_val = min_slider.Slider.Value
max_val = max_slider.Slider.Value
"""
# Actualizar el slider dinámico
update_slider(dynamic_slider, min_val, max_val)

# Salida del valor actual del slider dinámico
value = dynamic_slider.Slider.Value
# ---------- end python_2 ----------
panel = Panel(python.value)
panel_2 = Panel(python_2.value)
panel_3 = Panel("8")
py_mcslider = ControlASlider(dynamic_slider=Slider(9, range=0..15.8), max_val="15.8")  # -> out, value; inputs min_val: Int32
# ---------- py_mcslider: Python ----------
# To dynamically control a Slider. Set a min and max externally
#
#
# Copyright (c) 2024, Jordi Nebot <jordinebotroca@gmail.com>
# This rutine is free software: you can redistribute it and/or modify it under the terms of the GNU General Public License as published by the Free Software Foundation, either version 3 of the License, or (at your option) any later version.
#
# This rutine is distributed in the hope that it will be useful, but WITHOUT ANY WARRANTY; without even the implied warranty of MERCHANTABILITY or FITNESS FOR A PARTICULAR PURPOSE. See the GNU General Public License for more details.
#
# You should have received a copy of the GNU General Public License along with this program. If not, see http://www.gnu.org/licenses/.
#
# The GPL-3.0+ license <http://spdx.org/licenses/GPL-3.0+>
#
"""Use this component to To dynamically control a Slider. Set a min and max externally.
    Inputs:
        dynamic_slider: link with a slider, config the units inside it
        max_val: Sets the maximum value of the dynamic_slider. Pay attention to the decimals, it may be necessary to reconfigure the native slider. If not =100
        min_val: Sets the minumun value of the dynamic_slider. Pay attention to the decimals, it may be necessary to reconfigure the native slider. If not =0
    Output:
        value: Value of th dynamic_slider after to move it
"""
        
__author__ = "McNeibot"
__version__ = "2024.07.13"
                        
ghenv.Component.Name = "Control a Slider"
ghenv.Component.NickName =  "Py_McSlider"
ghenv.Component.Message = "VER 1.0\nJUL_2024"
#ghenv.Component.IconDisplayMode = ghenv.Component.IconDisplayMode.application
#ghenv.Component.Category = "McNeibot"
#ghenv.Component.SubCategory = "0 | McNeibot"
#compatibleGismoVersion = VER 0.0.3\nJAN_29_2019

                        
# -*- coding: utf-8 -*-                                                                                  
        

import clr
clr.AddReference('RhinoCommon')
import Rhino
import scriptcontext as sc
import Grasshopper
import Grasshopper.Kernel as gh
import Grasshopper.Kernel.Special as gh_special

def update_slider(slider, min_val, max_val):
    if slider is None:
        return

    # Configurar los límites mínimos y máximos del slider
    slider.Slider.Minimum = min_val
    slider.Slider.Maximum = max_val
    slider.Slider.TickFrequency = (max_val - min_val) / 10 if (max_val - min_val) > 0 else 1
    
    # Ajustar el valor del slider si está fuera de los nuevos límites
    if slider.Slider.Value < min_val or slider.Slider.Value > max_val:
        slider.Slider.Value = min_val
    
    # Expirar la solución para actualizar el slider
    slider.ExpireSolution(True)

# Obtener el slider conectado al componente Python
dynamic_slider = ghenv.Component.Params.Input[0].Sources[0]

# Verificar que el slider sea del tipo GH_NumberSlider
if not isinstance(dynamic_slider, gh_special.GH_NumberSlider):
    raise TypeError("El elemento conectado debe ser un slider de tipo GH_NumberSlider.")

# Definir los valores mínimo y máximo dinámicos
if min_val is None:
    min_val = 0  # Por ejemplo, puedes definir el valor mínimo aquí
if max_val is None:
    max_val = 100  # Por ejemplo, puedes definir el valor máximo aquí

# Actualizar el slider dinámico
update_slider(dynamic_slider, min_val, max_val)

# Salida del valor actual del slider dinámico
value = dynamic_slider.Slider.Value
# ---------- end py_mcslider ----------
panel_4 = Panel(py_mcslider.value)

# ----
# One Layer of the List
relay = Relay()
lng = ListLength(List=relay)
panel_5 = Panel(lng)

panel_6 = Panel("15.8")
relay_2 = Relay()
py_mcslider_2 = ControlASlider(dynamic_slider=Slider(0, range=0..100), max_val=lng, min_val=relay_2)  # -> out, value; inputs min_val: Int32; same code as py_mcslider

panel_8 = Panel(py_mcslider_2.value)
item = ListItem(List=relay, Index=py_mcslider_2.value, Wrap=True)
panel_9 = Panel(item)
