# Grasshopper definition Py_DateTime.gh (Grasshopper 1.0.7)
# plug-ins: FalseStartToggle

# ----
# Date & Time
panel = Panel("HIDDEN CONNECTION !!!")
filename = Relay()
path = Relay()
geo = Relay()
toggle = FalseStartToggle(False)
pt = Point("0,0,0")
py_datetime = Py_DateAndTimeNOW(run=Button())  # -> out, Date, Time, DateTime; inputs run: Boolean
# ---------- py_datetime: Python ----------
# Show actua date and time
#
#
# Copyright (c) 2020, Jordi Nebot <mcneibot@gmail.com>
# This component is free software: you can redistribute it and/or modify it under the terms of the GNU General Public License as published by the Free Software Foundation, either version 3 of the License, or (at your option) any later version.
#
# This component is distributed in the hope that it will be useful, but WITHOUT ANY WARRANTY; without even the implied warranty of MERCHANTABILITY or FITNESS FOR A PARTICULAR PURPOSE. See the GNU General Public License for more details.
#
# You should have received a copy of the GNU General Public License along with this program. If not, see http://www.gnu.org/licenses/.
#
# The GPL-3.0+ license <http://spdx.org/licenses/GPL-3.0+>

"""
Use this component to use the actual tiem and/or date.

    input:
        run: Button to update the date and time.
    
    output:
        Date: Actual Year+Month+Day
        Time: Actual Hour+Minute+Second
        DateTime: Actual Year+Month+Day + Hour+Minute+Second
        
"""

ghenv.Component.Name = "Py_Date and Time NOW"
ghenv.Component.NickName = "Py_DateTime"
ghenv.Component.Message = "VER 1.0\nAPR_14_2020"
#ghenv.Component.IconDisplayMode = ghenv.Component.IconDisplayMode.application
ghenv.Component.Category = "McNeibot"
ghenv.Component.SubCategory = "0 | McNeibot"
#try: ghenv.Component.AdditionalHelpFromDocStrings = "2"
#except: pass

__author__ = "McNeibot"
__version__ = "2020.04.14"

import rhinoscriptsyntax as rs
import datetime
#import time
"""
Date = datetime.date.today()
print Date
Time = datetime.time()
#DateTime = datetime.date.strftime(self: date, dateFormat: str)
print Time
"""
"""
if run == False:
    Now = datetime.datetime.now()
    #print Now
    Date = Now.strftime("%Y%m%d")
    Time = Now.strftime("%H%M%S")
    DateTime = Now.strftime("%Y%m%d-%H%M%S")
"""
Now = datetime.datetime.now()
#print Now
Date = Now.strftime("%Y%m%d")
Time = Now.strftime("%H%M%S")
DateTime = Now.strftime("%Y%m%d-%H%M%S")
#Now.strftime("%H:%M:%S")
#now.strftime("%m/%d/%Y-%H:%M:%S")
# ---------- end py_datetime ----------
py_run = GhPythonScript(run=toggle, data=path, joke=pt)  # -> out, a
# ---------- py_run: Python ----------
"""Provides a scripting component.
    Inputs:
        run: True to RUN
        data: any data
    Output:
        a: data input"""

__author__ = "McNeibot"
__version__ = "2021.01.29"

import rhinoscriptsyntax as rs
if run:
    a = data
else:
    a = joke
# ---------- end py_run ----------
panel_2 = Panel(py_datetime.DateTime)
extension = Panel(".dwg")
concat = Concatenate(FragmentB=filename, FragmentC="-", FragmentD="drenatge-", FragmentE=panel_2)
