# Grasshopper definition open a BROWSER.gh (Grasshopper 1.0.7)
# plug-ins: FalseStartToggle

panel = Panel("open a BROWSER")
panel_2 = Panel("http://www.juntadeandalucia.es/economiainnovacioncienciayempleo/pam/ConvED50.action")
toggle = FalseStartToggle(False)
py_mcurl = MCOpenURL(url=panel_2, run=toggle)  # -> out, URL
# ---------- py_mcurl: Python ----------
# This open a WWW with your default browser 
#
# Copyright (c) 2019, McNeibot <mcneibot@gmail.com>
# This is free software: you can redistribute it and/or modify it under the terms of the GNU General Public License as published by the Free Software Foundation, either version 3 of the License, or (at your option) any later version.
#
# This is distributed in the hope that it will be useful, but WITHOUT ANY WARRANTY; without even the implied warranty of MERCHANTABILITY or FITNESS FOR A PARTICULAR PURPOSE. See the GNU General Public License for more details.
#
# You should have received a copy of the GNU General Public License along with this program. If not, see http://www.gnu.org/licenses/.
#
# The GPL-3.0+ license <http://spdx.org/licenses/GPL-3.0+>

"""
Use this component to open a valid web page :WWW...., Internet adress, with your default browser.
-
Provided by McNeibot PyOpenURL 1.0

    input:
        url: A valid web page :WWW...., Internet adress, .
                       -
                       .
        run: TRUE, if you want open a url.
                   -
                   If nothing added to this input, then FALSE.
    
    output:
        URL: Your url.
        
"""
__author__ = "McNeibot"
__version__ = "2019.11.09"

ghenv.Component.Name = "MC Open URL"
ghenv.Component.NickName = "Py_McURL"
ghenv.Component.Message = "VER 1.0\n2019_11"
#ghenv.Component.IconDisplayMode = ghenv.Component.IconDisplayMode.application
#ghenv.Component.Category = "McNeibot"
#ghenv.Component.SubCategory = "0 | McNeibot"
import rhinoscriptsyntax as rs
import subprocess
import os
import webbrowser


if run is True and url:
    #subprocess.Popen('explorer url')
    #subprocess.Popen(r'"' + os.environ["PROGRAMFILES"] + '\Internet Explorer\IEXPLORE.EXE" ["url"]')
    #### iExplorer
    #ie = webbrowser.get(webbrowser.iexplore)
    #ie.open(url)
    # or:
    #webbrowser.get(webbrowser.iexplore).open(url)##good
    #
    #webbrowser.get(webbrowser.firefox).open(url)
    #webbrowser.get('C:/Program Files (x86)/Google/Chrome/Application/chrome.exe %s').open(url)
    #webbrowser.open_new_tab("http://www.google.com")
    #windows
    # chrome_path = 'C:/Program Files (x86)/Google/Chrome/Application/chrome.exe %s'
    #iExplore_path = os.environ["PROGRAMFILES"] +  "\Internet Explorer\IEXPLORE.EXE %s"
    #chrome_path = os.environ["PROGRAMFILES(X86)"] +  "\Google\Chrome\Application\chrome.exe"
    #webbrowser.get(os.environ["PROGRAMFILES(X86)"] +  "\Google\Chrome\Application\chrome.exe %s").open(url)
    #webbrowser.get(chrome_path).open(url)
    
    ##webbrowser.open(url, new=0, autoraise=True)
    ##Display url using the default browser. 
    ##If new is 0, the url is opened in the same browser window if possible. 
    ##If new is 1, a new browser window is opened if possible. 
    ##If new is 2, a new browser page (“tab”) is opened if possible. 
    ##If autoraise is True, the window is raised if possible (note that under many window managers this will occur regardless of the setting of this variable).
    webbrowser.open(url,1)
    # Open URL in a new tab, if a default browser window is already open.
    #webbrowser.open_new_tab(url)
    # Open URL in new window, raising the window if possible.
    #webbrowser.open_new(url)
    URL = url#, chrome_url
# ---------- end py_mcurl ----------
